# Grasshopper definition Speckle Grasshopper - Sample Scripts.gh (Grasshopper 1.0.8)
# plug-ins: Speckle.Connector.Grasshopper

# ---- group: STEP 1 : Get Speckle model link
# STEP 1
# 
# Get a link to any Speckle model.
# This sample script is linking to our demo Speckle Revit model.
# Copy paste the url in your browser to see the model online.
panel = Panel("https://app.speckle.systems/projects/8be1007be1/models/13a2953168")
speckle_model_url = SpeckleModelURL(
    SpeckleUrl=panel,
    Model="13a2953168",
    Project="8be1007be1",
    Server="https://app.speckle.systems",
    User="B8C2972E1A6094F9A8CCA818CE15D06F")

# Speckle for Grasshopper
# Welcome to the Speckle Next-Gen Grasshopper connector!
# Use these sample files for documentation on each Speckle node, and for example scripts of each core workflow:
# 
# (1) Design Coordination
# (2) Online Presentation
# (3) Business Intelligence
# 
# Speckle for Grasshopper and docs is built and maintained by claire@speckle.systems.
# Reach out on speckle.community for feedback, bug reports, and requests.
# Sample Script - Business Intelligence
# https://www.speckle.systems/use-cases/business-intelligence
# Calculate Concrete Properties on Floors inside a Revit Model
# This is a sample script to wrangle objects based on their metadata on any Speckle model published from other applications.
# Use data wrangling as part of your computation and analysis workflows.
# 
# This script will retrieve all floors in your model and find the density of all the materials in the floors.
# STEP 1
# 
# Get a link to any Speckle model.
# This sample script is linking to our demo Speckle Revit model.
# Copy paste the url in your browser to see the model online.
panel_2 = Panel("https://app.speckle.systems/projects/8be1007be1/models/13a2953168")
speckle_model_url_2 = SpeckleModelURL(
    SpeckleUrl=panel_2,
    Model="13a2953168",
    Project="8be1007be1",
    Server="https://app.speckle.systems",
    User="B8C2972E1A6094F9A8CCA818CE15D06F")

# ---- group: STEP 2 : Load your model
# STEP 2
# 
# Load your model by clicking `Load`.
load = Load(ModelLink=speckle_model_url)

# STEP 2
# 
# Load your model by clicking `Load`.
load_2 = Load(ModelLink=speckle_model_url_2)

# ---- group: STEP 3 : Get all Floors
# STEP 3
# 
# Retrieve all of the Floor objects inside your model.
# Simplify your Collection selection by editing the `Search` bar of the selector node to find all Collections containing the word "Floors".
# The output objects are `Mesh`, because this is the geometric representation of floors from Revit.
collection_selector = CollectionSelector(load_2, SearchPattern="?Floors")
getcollectionobjects = GetCollectionObjects(Collection=load_2, CollectionPath=collection_selector)
speckle_object = SpeckleObject(flatten(getcollectionobjects))

# ---- group: STEP 4 : Sort by Material
# STEP 4
# 
# Sort the floors by specific materials by using the Filter Objects node.
# We'll look at Concrete only to calculate carbon footprint.
# Since we don't care about the collection structure, flatten the input objects.
panel_3 = Panel("?density")
filter_objects = FilterObjects(Objects=speckle_object, PropertyKey=panel_3)  # -> Objects, CulledObjects
speckle_object_2 = SpeckleObject(filter_objects.Objects)

# ---- group: STEP 5 : Get Concrete Density
# STEP 5
# 
# Retrieve the density of the concrete on these floors.
# There may be different types of concrete - validate that they have the same density.
# Use the density to calculate the weight of your floors with the native GH volume component on your meshes!
property_selector = PropertySelector(speckle_object_2, SearchPattern="?density")
getobjectpropertyvalues = GetObjectPropertyValues(Objects=speckle_object_2, Keys=property_selector)  # -> MaterialQuantitiesConcretePrecastDensityValue, MaterialQuantitiesConcretePolishedDensityValue, MaterialQuantitiesConcretePrecastSmoothLightGreyDensityValue, MaterialQuantitiesConcreteCastInPlaceGrayDensityValue
getobjectpropertyvalues_2 = GetObjectPropertyValues(Objects=speckle_object_2, Keys=property_selector)  # -> MaterialQuantitiesConcreteCastInPlaceGrayDensityValue, MaterialQuantitiesConcretePolishedDensityValue, MaterialQuantitiesConcretePrecastDensityValue, MaterialQuantitiesConcretePrecastSmoothLightGreyDensityValue
create_set = CreateSet(List=flatten([getobjectpropertyvalues.MaterialQuantitiesConcretePrecastDensityValue, getobjectpropertyvalues.MaterialQuantitiesConcretePolishedDensityValue, getobjectpropertyvalues.MaterialQuantitiesConcretePrecastSmoothLightGreyDensityValue, getobjectpropertyvalues.MaterialQuantitiesConcreteCastInPlaceGrayDensityValue]))  # -> Set, Map

# ---- group: STEP 5 : Get Concrete Density / Density in Revit is in kg/ft3
panel_4 = Panel(create_set.Set)

# ---- group: STEP 3 : Create new Properties from Volume
# STEP 3
# 
# Retrieve all of the objects inside your model.
# Calculate the volume for each object using native GH components, converting from doc units to meters cubed.
# Create Speckle Properties for each object with the volume and units.
# Use the Create Speckle Object node to set these new Properties on your objects.
getcollectionobjects_2 = GetCollectionObjects(Collection=load)
speckle_object_3 = SpeckleObject(simplify(graft(getcollectionobjects_2)))

# ----
# Sample Script - Presentation
# https://www.speckle.systems/use-cases/online-collaboration
# Create a data visualisation of materials in a Revit model to share in the web
# This is a sample script to assign custom materials to a Grasshopper model to convey important information.
# Present and share your models online!
# 
# This script will colorize the Concrete objects in your Revit model in red and everything else is made translucent. All object properties are cleansed, leaving just the volume.
volume = Volume(Geometry=getcollectionobjects_2)  # -> Volume, Centroid
convert_units = ConvertUnits(Data=1, Source=1, Target=4)
power = Power(A=convert_units, B=3)
multiplication = Multiplication(A=volume.Volume, B=power)  # -> simplify(graft(Result))
create_material = CreateMaterial(
    Diffuse=ColourSwatch(SwatchColor=RGB(219, 219, 219)),
    Specular=RGB(255, 255, 255),
    Emission=RGB(0, 0, 0),
    Transparency=Slider(0.8, range=0..1),
    Shine=0)
create_material_2 = CreateMaterial(
    Diffuse=ColourSwatch(SwatchColor=RGB(242, 61, 24)),
    Specular=RGB(255, 255, 255),
    Emission=RGB(0, 0, 0),
    Transparency=Slider(0.1, range=0..1),
    Shine=0)

# ---- group: STEP 3 : Create new Properties from Volume (continued)
create_properties = CreateProperties(Volume=multiplication, Units="m3")
create_speckle_object = CreateSpeckleObject(Object=speckle_object_3, Properties=create_properties)  # -> Object, Geometry, Name, Properties, Color, Material, Path

# ---- group: STEP 4 : Sort Objects into Concrete and non-Concrete
# STEP 4
# 
# Filter the objects for Concrete material.
# This component will sort the input objects into those that match the search queries, and those that don't.
panel_5 = Panel("?Concrete")
speckle_object_4 = SpeckleObject(flatten(create_speckle_object.Object))
filterspeckleobjects = FilterSpeckleObjects(Objects=speckle_object_4, MaterialName=panel_5)  # -> Objects, CulledObjects
speckle_object_5 = SpeckleObject(filterspeckleobjects.CulledObjects)
speckle_object_6 = SpeckleObject(filterspeckleobjects.Objects)

# ---- group: STEP 5 : Change Object Materials
# STEP 5
# 
# Create a translucent material to apply to non-concrete objects.
# Create a red material to apply to concrete objects.
# Then override the material and properties of all objects.
create_speckle_object_2 = CreateSpeckleObject(Object=speckle_object_5, Material=create_material)  # -> Object, Geometry, Name, Properties, Color, Material, Path
create_speckle_object_3 = CreateSpeckleObject(Object=speckle_object_6, Material=create_material_2)  # -> Object, Geometry, Name, Properties, Color, Material, Path

# ---- group: STEP 6 : Create Collections
# STEP 6
# 
# Create a collection for the concrete objects, named "Concrete".
# Create a collection for all other objects, named "Other".
# Add your objects into their respective Collection.
create_collection = CreateCollection(Concrete=create_speckle_object_3.Object, Other=create_speckle_object_2.Object)

# ---- group: STEP 7 : Publish!
# STEP 7
# 
# Select a Speckle Model to publish to, or use the provided Public Grasshopper project.
# Once published, right-click the Publish node.
# This will open up your model in your web browser :)
# https://app.speckle.systems/projects/fddfc547ee/models/5a25c4b5cc
speckle_model_url_3 = SpeckleModelURL(Model="5a25c4b5cc", Project="fddfc547ee", Server="https://app.speckle.systems", User="B8C2972E1A6094F9A8CCA818CE15D06F")
publish = Publish(ModelLink=speckle_model_url_3, Collection=create_collection)
